% Simulink data dictionary AppSoftware.sldd
% references CanInputInterface.sldd
% references CanCommands.sldd
% references UserOneButtonInterface.sldd

AmbientLightRequest_sig = Simulink.Signal(StorageClass="ExportToFile", HeaderFile="interfaces.h", DefinitionFile="interfaces.c", DataType="boolean")
AmbientLightOnTime_C = Simulink.Parameter(18000, StorageClass="Const", HeaderFile="tunableParams.h", DefinitionFile="tunableParams.c", DataType="uint16", Min=0, Max=65000)
HBridgeFailureCode_sig = Simulink.Signal(StorageClass="ExportToFile", HeaderFile="interfaces.h", DefinitionFile="interfaces.c", DataType="boolean")
MotorCurrentADCRawValue_sig = Simulink.Signal(StorageClass="ExportToFile", HeaderFile="interfaces.h", DefinitionFile="interfaces.c", DataType="uint16")
MotorDirection_sig = Simulink.Signal(StorageClass="ExportToFile", HeaderFile="interfaces.h", DefinitionFile="interfaces.c", DataType="boolean")
MotorRotationRequest_sig = Simulink.Signal(StorageClass="ExportToFile", HeaderFile="interfaces.h", DefinitionFile="interfaces.c", DataType="boolean")
ApplicationInternalError_sig = Simulink.Signal(StorageClass="ExportToFile", HeaderFile="interfaces.h", DefinitionFile="interfaces.c", DataType="boolean")
HAL_getMstime_sig = Simulink.Signal(StorageClass="ExportToFile", HeaderFile="interfaces.h", DefinitionFile="interfaces.c", DataType="uint32")
DebounceStepsToSetMinimumCurrError_C = Simulink.Parameter(3, StorageClass="Const", HeaderFile="tunableParams.h", DefinitionFile="tunableParams.c", DataType="uint8", Min=0, Max=100)
IPROPFactor_C = Simulink.Parameter(1100, StorageClass="Const", HeaderFile="tunableParams.h", DefinitionFile="tunableParams.c", DataType="uint16")
IpropResistorValue_C = Simulink.Parameter(402, StorageClass="Const", HeaderFile="tunableParams.h", DefinitionFile="tunableParams.c", DataType="uint16", Unit="Ω")
ADCResolutionmVproBit_C = Simulink.Parameter(0.0008056640625, StorageClass="Const", HeaderFile="tunableParams.h", DefinitionFile="tunableParams.c", DataType="single")
MaxMotorCurrent_C = Simulink.Parameter(8, StorageClass="Const", HeaderFile="tunableParams.h", DefinitionFile="tunableParams.c", DataType="single", Min=0, Max=10000, Unit="A")
MinMotorCurrent_C = Simulink.Parameter(0.1, StorageClass="Const", HeaderFile="tunableParams.h", DefinitionFile="tunableParams.c", DataType="single", Min=0, Max=10000, Unit="A")
AmbientLightSystem = Simulink.Parameter(1, StorageClass="ImportedExtern", DataType="boolean")
UserButton = Simulink.Parameter(1, StorageClass="ImportedExtern")
dasdf = Simulink.Parameter(1, StorageClass="ImportedExtern")
CanInterface = Simulink.Parameter(0, StorageClass="ImportedExtern", DataType="boolean")
StartStopUserRequest_sig = Simulink.Signal(StorageClass="ExportedGlobal", DataType="Enum: MotorStates_e")
MotorSpdUserRequest_sig = Simulink.Signal(StorageClass="ExportedGlobal", DataType="uint8", Unit="percent")
MotorSpdPWMRawValue_sig = Simulink.Signal(StorageClass="ExportToFile", HeaderFile="interfaces.h", DefinitionFile="interfaces.c", DataType="uint16")